# Dynamo graph Corridor Barrier Setout - SW.dyn (Dynamo 2.5.2.7915)
# packages: Civil3DToolkit 1.1.19

# group: Usage metric collection
code_block = CodeBlock { "Corridor Barrier Setout"; "0.1.0"; }
usageMetrics = Custom[UsageMetrics](scriptName=code_block.out0, scriptVersion=code_block.out1)  # Tracks run information an uploads to Power BI Database

# group: Get Corridor Feature Lines
corridor_name = CorridorNameDropDown("Pokeno Road 4Lane")  # graph input
corridor_barrier_code = StringInput("Barrier")  # graph input
corridorFeatureLinesByCode = Custom[CorridorFeatureLinesByCode](corridor=corridor_name, code=corridor_barrier_code)  # frozen; Returns all corridor feature lines for a given code

# group: Set barrier draw layer
barrier_draw_layer = StringInput("Barrier")  # graph input

# group: Start Terminal Creation
startStation = Autodesk.Civil.DynamoNodes.CorridorFeatureLine.StartStation(corridorFeatureLine=corridorFeatureLinesByCode.CorridorFeatureLine)
start_terminal_offset = DoubleSlider(15, range=0..500 step 1)  # graph input
add = startStation + start_terminal_offset
start_terminal_block_name = StringInput("TL3_Terminal")  # graph input
start_terminal_rotation_angle = DoubleInput(0)  # graph input
placeBlocksAlongCorridorFeatureLine = Custom[PlaceBlocksAlongCorridorFeatureLine](corridorFeatureLine=corridorFeatureLinesByCode.CorridorFeatureLine, station=add, blockName=start_terminal_block_name, blockRotationAngle=start_terminal_rotation_angle, layer=barrier_draw_layer)  # frozen; Places specified blocks along corridor feature lines at given station locations

# group: Post Creation
startStation_2 = Autodesk.Civil.DynamoNodes.CorridorFeatureLine.StartStation(corridorFeatureLine=corridorFeatureLinesByCode.CorridorFeatureLine)
start_post_offset = DoubleSlider(15.5, range=0..500 step 1)  # graph input
add_2 = startStation_2 + start_post_offset
endStation = Autodesk.Civil.DynamoNodes.CorridorFeatureLine.EndStation(corridorFeatureLine=corridorFeatureLinesByCode.CorridorFeatureLine)
end_post_offset = DoubleSlider(15.5, range=0..500 step 1)  # graph input
# note: Add bool to equalise start end spacing
sub = endStation - end_post_offset
post_spacing = DoubleSlider(2, range=0..500 step 1)  # graph input
range = Range(start=add_2, end=sub, step=post_spacing)
post_block_name = StringInput("TL3_Post")  # graph input
post_rotation_angle = DoubleInput(0)  # graph input
placeBlocksAlongCorridorFeatureLine_2 = Custom[PlaceBlocksAlongCorridorFeatureLine](corridorFeatureLine=corridorFeatureLinesByCode.CorridorFeatureLine, station=range, blockName=post_block_name, blockRotationAngle=post_rotation_angle, layer=barrier_draw_layer)  # frozen

# group: End Terminal Creation
endStation_2 = Autodesk.Civil.DynamoNodes.CorridorFeatureLine.EndStation(corridorFeatureLine=corridorFeatureLinesByCode.CorridorFeatureLine)
end_terminal_offset = DoubleSlider(15, range=0..500 step 1)  # graph input
sub_2 = endStation_2 - end_terminal_offset
end_terminal_block_name = StringInput("TL3_Terminal")  # graph input
end_terminal_rotation_angle = DoubleInput(180)  # graph input
placeBlocksAlongCorridorFeatureLine_3 = Custom[PlaceBlocksAlongCorridorFeatureLine](corridorFeatureLine=corridorFeatureLinesByCode.CorridorFeatureLine, station=sub_2, blockName=end_terminal_block_name, blockRotationAngle=end_terminal_rotation_angle, layer=barrier_draw_layer)  # frozen

# group: Get lists of terminal and post objects
join = List.Join()  # unwired: list0, list1, list2
code_block_2 = CodeBlock { 2; }
flatten = List.Flatten(list=placeBlocksAlongCorridorFeatureLine.BlockReference, amt=code_block_2)
code_block_3 = CodeBlock { 1; }
chop = List.Chop(list=flatten, lengths=code_block_3)
code_block_4 = CodeBlock { 1; }
flatten_2 = List.Flatten(list=placeBlocksAlongCorridorFeatureLine_2.BlockReference, amt=code_block_4)
code_block_5 = CodeBlock { 2; }
flatten_3 = List.Flatten(list=placeBlocksAlongCorridorFeatureLine_3.BlockReference, amt=code_block_5)
code_block_6 = CodeBlock { 1; }
chop_2 = List.Chop(list=flatten_3, lengths=code_block_6)
combine = List.Combine(comb=join, list1=chop, list2=flatten_2, list3=chop_2)

# group: Place Barrier Elements
post_block_name_2 = StringInput("Wire_Rope_Barrier")  # graph input
placeBarrierBlocks = Custom[PlaceBarrierBlocks](blockReferencesToJoin=combine, blockName=post_block_name_2, drawLayer=barrier_draw_layer)

watch = Watch(endStation)
polyCurve = Autodesk.Civil.DynamoNodes.CorridorFeatureLine.PolyCurve(corridorFeatureLine=corridorFeatureLinesByCode.CorridorFeatureLine)
start_terminal_offset_2 = DoubleSlider(15.5, range=0..500 step 1)  # graph input
code_block_7 = CodeBlock(layer=barrier_draw_layer) { layer; }

# group: Polyline set out start terminal
post_block_name_3 = StringInput("TL3_Terminal")  # graph input
post_rotation_angle_2 = DoubleInput(0)  # graph input
placeBlocksAlongPolycurve = Custom[PlaceBlocksAlongPolycurve](polycurve=polyCurve, station=start_terminal_offset_2, blockName=post_block_name_3, blockRotationAngle=post_rotation_angle_2, layer=code_block_7)

length = Curve.Length(curve=polyCurve)
end_terminal_offset_2 = DoubleSlider(15.5, range=0..500 step 1)  # graph input
sub_3 = length - end_terminal_offset_2
post_spacing_2 = DoubleSlider(2, range=0..500 step 1)  # graph input

# group: Polyline set out posts
range_2 = Range(start=start_terminal_offset_2, end=sub_3, step=post_spacing_2)
post_block_name_4 = StringInput("TL3_Post")  # graph input
post_rotation_angle_3 = DoubleInput(0)  # graph input

sub_4 = sub_3 - start_terminal_offset_2
# note: Equalise start and end posts
mod = sub_4 % post_spacing_2
code_block_8 = CodeBlock(a=range_2, b=mod) { a; b; c=a+b/2; }

# group (continued): Polyline set out posts
placeBlocksAlongPolycurve_2 = Custom[PlaceBlocksAlongPolycurve](polycurve=polyCurve, station=code_block_8.c, blockName=post_block_name_4, blockRotationAngle=post_rotation_angle_3, layer=code_block_7)

# group: Polyline set out end terminal
post_block_name_5 = StringInput("TL3_Terminal")  # graph input
post_rotation_angle_4 = DoubleInput(180)  # graph input
placeBlocksAlongPolycurve_3 = Custom[PlaceBlocksAlongPolycurve](polycurve=polyCurve, station=sub_3, blockName=post_block_name_5, blockRotationAngle=post_rotation_angle_4, layer=code_block_7)

# group: Get lists of terminal and post objects
join_2 = List.Join()  # unwired: list0, list1, list2
code_block_9 = CodeBlock(start_terminal=placeBlocksAlongPolycurve.BlockReference) { start_terminal; }
code_block_10 = CodeBlock { 2; }
flatten_4 = List.Flatten(list=code_block_9, amt=code_block_10)
code_block_11 = CodeBlock { 1; }
chop_3 = List.Chop(list=flatten_4, lengths=code_block_11)
code_block_12 = CodeBlock(posts=placeBlocksAlongPolycurve_2.BlockReference) { posts; }
code_block_13 = CodeBlock { 1; }
flatten_5 = List.Flatten(list=code_block_12, amt=code_block_13)
code_block_14 = CodeBlock(end_terminal=placeBlocksAlongPolycurve_3.BlockReference) { end_terminal; }
code_block_15 = CodeBlock { 2; }
flatten_6 = List.Flatten(list=code_block_14, amt=code_block_15)
code_block_16 = CodeBlock { 1; }
chop_4 = List.Chop(list=flatten_6, lengths=code_block_16)
combine_2 = List.Combine(comb=join_2, list1=chop_3, list2=flatten_5, list3=chop_4)

# group: Place Barrier Elements
post_block_name_6 = StringInput("Wire_Rope_Barrier")  # graph input
placeBarrierBlocks_2 = Custom[PlaceBarrierBlocks](blockReferencesToJoin=combine_2, blockName=post_block_name_6, drawLayer=barrier_draw_layer)

watch_2 = Watch(code_block_8.c)
watch_3 = Watch(range_2)
addNewTypes = Autodesk.AutoCAD.DynamoNodes.DocumentExtensions.AddNewTypes()
objects_types = AcObjectTypes("FeatureLine")
current = Autodesk.AutoCAD.DynamoNodes.Document.Current()
modelSpace = Autodesk.AutoCAD.DynamoNodes.Document.ModelSpace(document=current)
all_objects_of_type = AcObjectsOfType(type=objects_types, block=modelSpace)
name = Autodesk.Civil.DynamoNodes.CivilObject.Name(civilObject=all_objects_of_type)
code_block_17 = CodeBlock { ""; }
eq = name == code_block_17
filterByBoolMask = List.FilterByBoolMask(list=all_objects_of_type, mask=eq)
filterByBoolMask_2 = List.FilterByBoolMask(list=name, mask=eq)
code_block_18 = CodeBlock(feature_lines=filterByBoolMask.out, feature_line_names=filterByBoolMask_2.out) { feature_lines; feature_line_names; }
watch_4 = Watch(code_block_18.feature_lines)
watch_5 = Watch(code_block_18.feature_line_names)
