# Dynamo custom node CorridorFeatureLinesByCode.dyf (Dynamo 2.5.2.7915)
# category: SIP_Tools
# Returns all corridor feature lines for a given code
# packages: Civil3DToolkit 1.1.19

corridor = Input(corridor: Autodesk.Civil.DynamoNodes.Corridor)
baselines = Autodesk.Civil.DynamoNodes.Corridor.Baselines(corridor=corridor)
codes = Autodesk.Civil.DynamoNodes.Baseline.Codes(baseline=baselines)
code = Input(code: var)
contains = List.Contains(list=codes.Point_Codes@L2, item=code)
filterByBoolMask = List.FilterByBoolMask(list=baselines, mask=contains)
code_block = CodeBlock(t1=filterByBoolMask.in, t2=code) { corridorfeatureline1 = Baseline.CorridorFeatureLinesByCode(t1, t2); }
CorridorFeatureLine = Output(code_block)  # "CorridorFeatureLine[]"
getTkFeatureLinesByCode = Autodesk.Civil.DynamoNodes.CorridorExtensions.CorridorExtensions.GetTkFeatureLinesByCode(baseline=filterByBoolMask.in, code=code)
TkCorridorFeatureLine = Output(getTkFeatureLinesByCode)  # "TkCorridorFeatureLine[]"
