# Dynamo graph Feature Line Barrier Setout - SW.dyn (Dynamo 2.5.2.7915)
# packages: Civil 3D Barrier Tool 0.1.0 Custom Nodes 0.1.0, Civil3DToolkit 1.1.19, Data-Shapes 2021.2.94

# group: Usage metric collection
code_block = CodeBlock { "Civil 3D Barrier Tool"; "0.1.0"; }
# note: Get existing feature lines
usageMetrics = Custom[UsageMetrics](scriptName=code_block.out0, scriptVersion=code_block.out1)  # package Civil 3D Barrier Tool 0.1.0 Custom Nodes; Tracks run information an uploads to Power BI Database

string = StringInput("Select feature line for creation of barrier")
code_block_2 = CodeBlock { "Next"; "Cancel"; "DOC_LINK"; 600; 300; "./Logo.png"; }
string_2 = StringInput("Feature Line")
objects_types = AcObjectTypes("Polyline")
current = Autodesk.AutoCAD.DynamoNodes.Document.Current()
modelSpace = Autodesk.AutoCAD.DynamoNodes.Document.ModelSpace(document=current)
all_objects_of_type = AcObjectsOfType(type=objects_types, block=modelSpace)
name = Autodesk.Civil.DynamoNodes.CivilObject.Name(civilObject=all_objects_of_type)
code_block_3 = CodeBlock { ""; }
eq = name == code_block_3
filterByBoolMask = List.FilterByBoolMask(list=all_objects_of_type, mask=eq)
filterByBoolMask_2 = List.FilterByBoolMask(list=name, mask=eq)
code_block_4 = CodeBlock(feature_lines=filterByBoolMask.out, feature_line_names=filterByBoolMask_2.out) { feature_lines; feature_line_names; }
code_block_5 = CodeBlock { 0; }
dropdown_data = Custom[DropDown Data](InputName=string_2, Keys=code_block_4.feature_line_names, Values=code_block_4.feature_lines, DefaultValueIndex=code_block_5)  # package Data-Shapes; Create data for DropDown input in UI.MultiInputForm ++ . Check out www.data-shapes.net for more infos.
list_create = List.Create(item0=dropdown_data)
boolean = BoolSelector(true)
multipleinputform = Custom[MultipleInputForm ++](Description_optional=string, Logo_optional=code_block_2.out5, ButtonText_optional=code_block_2.out0, Inputs=list_create, Toggle=boolean, LinkToHelp_optional=code_block_2.out2, CancelButtonText_optional=code_block_2.out1, Width_optional=code_block_2.out3, LabelWidth_optional=code_block_2.out4)  # package Data-Shapes; Create a form with multiple inputs. see www.data-shapes.net for tutorials and infos!
code_block_6 = CodeBlock(result=multipleinputform.User_Inputs) { featureLine = result[0]; }

# group: Creare Polyline List
code_block_7 = CodeBlock(featureLine=code_block_6) { FeatureLine.GetRefinedPolyCurve(featureLine); }
list_create_2 = List.Create(item0=code_block_7)

string_3 = StringInput("Set barrier parameters")
code_block_8 = CodeBlock { "Create Barrier"; "Cancel"; "DOC_LINK"; 600; 300; "./Logo.png"; }
code_block_9 = CodeBlock { "Post Spacing"; "2.000"; }
boolean_2 = BoolSelector(true)
textbox_data = Custom[TextBox Data](InputName=code_block_9.out0, DefaultText=code_block_9.out1, IsNumberEntry=boolean_2)  # package Data-Shapes; Create Data for TextBox input in UI.MultipleInputForm ++ . Check out www.data-shapes.net for more informations
code_block_10 = CodeBlock { "Start Offset"; "0.000"; }
boolean_3 = BoolSelector(true)
textbox_data_2 = Custom[TextBox Data](InputName=code_block_10.out0, DefaultText=code_block_10.out1, IsNumberEntry=boolean_3)
code_block_11 = CodeBlock { "End Offset"; "0.000"; }
boolean_4 = BoolSelector(true)
textbox_data_3 = Custom[TextBox Data](InputName=code_block_11.out0, DefaultText=code_block_11.out1, IsNumberEntry=boolean_4)
code_block_12 = CodeBlock { "Equalise Start and End Spacings"; ""; }
boolean_5 = BoolSelector(true)
boolean_input = Custom[Boolean input](InputName=code_block_12.out0, DefaultValue=boolean_5, SideText=code_block_12.out1)  # package Data-Shapes; Creates a boolean input for UI.MultipleInputForm ++ . Check out www.data-shapes.net for more infos!
code_block_13 = CodeBlock { "Start Rotation"; "0.000"; }
boolean_6 = BoolSelector(true)
textbox_data_4 = Custom[TextBox Data](InputName=code_block_13.out0, DefaultText=code_block_13.out1, IsNumberEntry=boolean_6)
code_block_14 = CodeBlock { "End Rotation"; "0.000"; }
boolean_7 = BoolSelector(true)
textbox_data_5 = Custom[TextBox Data](InputName=code_block_14.out0, DefaultText=code_block_14.out1, IsNumberEntry=boolean_7)
code_block_15 = CodeBlock { "Output Layer"; "BARRIER"; }
boolean_8 = BoolSelector(false)
textbox_data_6 = Custom[TextBox Data](InputName=code_block_15.out0, DefaultText=code_block_15.out1, IsNumberEntry=boolean_8)
list_create_3 = List.Create(item0=textbox_data, item1=textbox_data_2, item2=textbox_data_3, item3=boolean_input, item4=textbox_data_4, item5=textbox_data_5, item6=textbox_data_6)
string_4 = StringInput("Select barrier blocks")
code_block_16 = CodeBlock { "Next"; "Cancel"; "DOC_LINK"; 600; 300; "./Logo.png"; }
string_5 = StringInput("Barrier Block")
string_6 = StringInput("Barr")
filterBlocksByName = Custom[FilterBlocksByName](nameFilter=string_6)  # package Civil 3D Barrier Tool 0.1.0 Custom Nodes; Filters blocks based on given string. Outputs blocks and block names that containt the input string.
code_block_17 = CodeBlock { 0; }
dropdown_data_2 = Custom[DropDown Data](InputName=string_5, Keys=filterBlocksByName.BlockNames, Values=filterBlocksByName.Blocks, DefaultValueIndex=code_block_17)
string_7 = StringInput("Post Block")
string_8 = StringInput("Post")
filterBlocksByName_2 = Custom[FilterBlocksByName](nameFilter=string_8)
code_block_18 = CodeBlock { 0; }
dropdown_data_3 = Custom[DropDown Data](InputName=string_7, Keys=filterBlocksByName_2.BlockNames, Values=filterBlocksByName_2.Blocks, DefaultValueIndex=code_block_18)
string_9 = StringInput("Start Terminal/Transition Block")
string_10 = StringInput("Terminal")
filterBlocksByName_3 = Custom[FilterBlocksByName](nameFilter=string_10)
code_block_19 = CodeBlock { "None"; }
count = List.Count(list=filterBlocksByName_3.BlockNames)
insert = List.Insert(list=filterBlocksByName_3.BlockNames, element=code_block_19, index=count)
code_block_20 = CodeBlock { "None"; }
count_2 = List.Count(list=filterBlocksByName_3.Blocks)
# note: TODO: Add none option to terminal selection
insert_2 = List.Insert(list=filterBlocksByName_3.Blocks, element=code_block_20, index=count_2)
code_block_21 = CodeBlock { 0; }
dropdown_data_4 = Custom[DropDown Data](InputName=string_9, Keys=insert, Values=insert_2, DefaultValueIndex=code_block_21)
string_11 = StringInput("EndTerminal/Transition Block")
code_block_22 = CodeBlock { 0; }
dropdown_data_5 = Custom[DropDown Data](InputName=string_11, Keys=insert, Values=insert_2, DefaultValueIndex=code_block_22)
list_create_4 = List.Create(item0=dropdown_data_2, item1=dropdown_data_3, item2=dropdown_data_4, item3=dropdown_data_5)
boolean_9 = BoolSelector(true)
not_ = Not(x=multipleinputform.Was_Cancelled)
and_ = And(bool0=multipleinputform.Was_Run, bool1=boolean_9, bool2=not_)
multipleinputform_2 = Custom[MultipleInputForm ++](Description_optional=string_4, Logo_optional=code_block_16.out5, ButtonText_optional=code_block_16.out0, Inputs=list_create_4, Toggle=and_, LinkToHelp_optional=code_block_16.out2, CancelButtonText_optional=code_block_16.out1, Width_optional=code_block_16.out3, LabelWidth_optional=code_block_16.out4)
boolean_10 = BoolSelector(true)
not_2 = Not(x=multipleinputform_2.Was_Cancelled)
and_2 = And(bool0=multipleinputform_2.Was_Run, bool1=boolean_10, bool2=not_2)
multipleinputform_3 = Custom[MultipleInputForm ++](Description_optional=string_3, Logo_optional=code_block_8.out5, ButtonText_optional=code_block_8.out0, Inputs=list_create_3, Toggle=and_2, LinkToHelp_optional=code_block_8.out2, CancelButtonText_optional=code_block_8.out1, Width_optional=code_block_8.out3, LabelWidth_optional=code_block_8.out4)
code_block_23 = CodeBlock(result=multipleinputform_3.User_Inputs)
# ---------- code_block_23.designscript (7 lines) ----------
postSpacing = result[0];
startOffset = result[1];
endOffset = result[2];
equaliseSpacings = result[3];
startRotation = result[4];
endRotation = result[5];
outputLayer = result[6];
# ----------------------------------------
code_block_24 = CodeBlock(postSpacing=code_block_23.postSpacing, startTerminalOffset=code_block_23.startOffset, endTerminalOffset=code_block_23.endOffset) { postSpacing; startTerminalOffset; endTerminalOffset; }
code_block_25 = CodeBlock(result=multipleinputform_2.User_Inputs) { barrierBlock = result[0]; postBlock = result[1]; startTerminalBlock = result[2]; endTerminalBlock = result[3]; }

# group: Add terminal lengths to offsets
blockXLength = Custom[BlockXLength](block=code_block_25.startTerminalBlock)  # package Civil 3D Barrier Tool 0.1.0 Custom Nodes; Returns the length of a block in the X direction
add = code_block_24.startTerminalOffset + blockXLength
blockXLength_2 = Custom[BlockXLength](block=code_block_25.endTerminalBlock)
add_2 = code_block_24.endTerminalOffset + blockXLength_2

code_block_26 = CodeBlock(layer=code_block_23.outputLayer) { layer; }

# group: Polyline set out start terminal
name_2 = Autodesk.AutoCAD.DynamoNodes.Block.Name(block=code_block_25.startTerminalBlock)
post_rotation_angle = DoubleInput(0)
add_3 = post_rotation_angle + code_block_23.startRotation
placeBlocksAlongPolycurve = Custom[PlaceBlocksAlongPolycurve](polycurve=list_create_2, station=add, blockName=name_2, blockRotationAngle=add_3, layer=code_block_26)  # package Civil 3D Barrier Tool 0.1.0 Custom Nodes

# group: Calculate end point
length = Curve.Length(curve=list_create_2)
sub = length - add_2

# group: Calculate offset to equalise start and end spacings
sub_2 = sub - add
mod = sub_2 % code_block_24.postSpacing

# group: Polyline set out posts
range = Range(start=add, end=sub, step=code_block_24.postSpacing)
offset_points = CodeBlock(a=range, b=mod) { a; b; c=a+b/2; }
if_ = If(test=code_block_23.equaliseSpacings, true=offset_points.c, false=range)
name_3 = Autodesk.AutoCAD.DynamoNodes.Block.Name(block=code_block_25.postBlock)
post_rotation_angle_2 = DoubleInput(0)
placeBlocksAlongPolycurve_2 = Custom[PlaceBlocksAlongPolycurve](polycurve=list_create_2, station=if_, blockName=name_3, blockRotationAngle=post_rotation_angle_2, layer=code_block_26)

# group: Polyline set out end terminal
name_4 = Autodesk.AutoCAD.DynamoNodes.Block.Name(block=code_block_25.endTerminalBlock)
post_rotation_angle_3 = DoubleInput(180)
add_4 = post_rotation_angle_3 + code_block_23.endRotation
placeBlocksAlongPolycurve_3 = Custom[PlaceBlocksAlongPolycurve](polycurve=list_create_2, station=sub, blockName=name_4, blockRotationAngle=add_4, layer=code_block_26)

# group: Get lists of terminal and post objects
join = List.Join()  # unwired: list0, list1, list2
code_block_27 = CodeBlock(start_terminal=placeBlocksAlongPolycurve.BlockReference) { start_terminal; }
code_block_28 = CodeBlock { 2; }
flatten = List.Flatten(list=code_block_27, amt=code_block_28)
code_block_29 = CodeBlock { 1; }
chop = List.Chop(list=flatten, lengths=code_block_29)
code_block_30 = CodeBlock(posts=placeBlocksAlongPolycurve_2.BlockReference) { posts; }
code_block_31 = CodeBlock(end_terminal=placeBlocksAlongPolycurve_3.BlockReference) { end_terminal; }
code_block_32 = CodeBlock { 2; }
flatten_2 = List.Flatten(list=code_block_31, amt=code_block_32)
code_block_33 = CodeBlock { 1; }
chop_2 = List.Chop(list=flatten_2, lengths=code_block_33)
combine = List.Combine(comb=join, list1=chop, list2=code_block_30, list3=chop_2)

# group: Place Barrier Elements
name_5 = Autodesk.AutoCAD.DynamoNodes.Block.Name(block=code_block_25.barrierBlock)
placeBarrierBlocks = Custom[PlaceBarrierBlocks](blockReferencesToJoin=combine, blockName=name_5, drawLayer=code_block_26)  # package Civil 3D Barrier Tool 0.1.0 Custom Nodes

# group: Add Types
addNewTypes = Autodesk.AutoCAD.DynamoNodes.DocumentExtensions.AddNewTypes()
